# Dynamo graph Маркировка по разделу.dyn (Dynamo 2.0.3.8810)

categories = Categories(index=372)  # graph input
all_elements_of_category = ElementsOfCategory(Category=categories)
code_block = CodeBlock { "ADSK_Обозначение системы"; }
getParameterValueByName = Element.GetParameterValueByName(element=all_elements_of_category, parameterName=code_block)
code_block_2 = CodeBlock { "ОВ"; }
eq = getParameterValueByName == code_block_2
filterByBoolMask = List.FilterByBoolMask(list=all_elements_of_category, mask=eq)
code_block_3 = CodeBlock { "Марка"; }
code_block_4 = CodeBlock { 1; }
count = List.Count(list=filterByBoolMask.in)
sequence = Sequence(start=code_block_4, amount=count, lacing=Longest)
string_from_object = FromObject(obj=sequence)
setParameterByName = Element.SetParameterByName(element=filterByBoolMask.in, parameterName=code_block_3, value=string_from_object)
getParameterValueByName_2 = Element.GetParameterValueByName(element=all_elements_of_category, parameterName=code_block)
code_block_5 = CodeBlock { "ВК"; }
eq_2 = getParameterValueByName_2 == code_block_5
filterByBoolMask_2 = List.FilterByBoolMask(list=all_elements_of_category, mask=eq_2)
code_block_6 = CodeBlock { "Марка"; }
code_block_7 = CodeBlock { 1; }
count_2 = List.Count(list=filterByBoolMask_2.in)
sequence_2 = Sequence(start=code_block_7, amount=count_2, lacing=Longest)
string_from_object_2 = FromObject(obj=sequence_2)
setParameterByName_2 = Element.SetParameterByName(element=filterByBoolMask_2.in, parameterName=code_block_6, value=string_from_object_2)
getParameterValueByName_3 = Element.GetParameterValueByName(element=all_elements_of_category, parameterName=code_block)
code_block_8 = CodeBlock { "CC"; }
eq_3 = getParameterValueByName_3 == code_block_8
filterByBoolMask_3 = List.FilterByBoolMask(list=all_elements_of_category, mask=eq_3)
code_block_9 = CodeBlock { "Марка"; }
code_block_10 = CodeBlock { 1; }
count_3 = List.Count(list=filterByBoolMask_3.in)
sequence_3 = Sequence(start=code_block_10, amount=count_3, lacing=Longest)
string_from_object_3 = FromObject(obj=sequence_3)
setParameterByName_3 = Element.SetParameterByName(element=filterByBoolMask_3.in, parameterName=code_block_9, value=string_from_object_3)
getParameterValueByName_4 = Element.GetParameterValueByName(element=all_elements_of_category, parameterName=code_block)
code_block_11 = CodeBlock { "ЭОМ"; }
eq_4 = getParameterValueByName_4 == code_block_11
filterByBoolMask_4 = List.FilterByBoolMask(list=all_elements_of_category, mask=eq_4)
code_block_12 = CodeBlock { "Марка"; }
code_block_13 = CodeBlock { 1; }
count_4 = List.Count(list=filterByBoolMask_4.in)
sequence_4 = Sequence(start=code_block_13, amount=count_4, lacing=Longest)
string_from_object_4 = FromObject(obj=sequence_4)
setParameterByName_4 = Element.SetParameterByName(element=filterByBoolMask_4.in, parameterName=code_block_12, value=string_from_object_4)
